# Grasshopper definition forma-api.gh (Grasshopper 1.0.7)
# Copyright: 2020
# plug-ins: Swiftlet, jSwan, ProceduralCS, Formicae

panel = Panel("https://app.autodeskforma.eu/designmode/pro_74nzjy4r4h/03ac9e63-182e-41b2-b5af-81e7b3ee2088")
auth = Auth(Trigger=Button())
clean = CleanTree(RemoveNulls=True, RemoveInvalid=True, RemoveEmpty=False, Tree=auth)
data = Data(flatten(clean))
pipeline = GeometryPipeline(
    GroupByLayer=False,
    GroupByType=False,
    IncludeHidden=True,
    IncludeLocked=True,
    LayerFilter="Forma::Terrain",
    NameFilter="*",
    SublayerFiltering=True,
    TypeFilter=32)
pipeline_2 = GeometryPipeline(
    GroupByLayer=False,
    GroupByType=False,
    IncludeHidden=True,
    IncludeLocked=True,
    LayerFilter="Forma::Buildings",
    NameFilter="*",
    SublayerFiltering=True,
    TypeFilter=1073741880)
python = GhPythonScript()  # -> out, key, value
# ---------- python: Python ----------
import rhinoscriptsyntax as rs

ghenv.Component.Message = "x-ads-region"


key = "x-ads-region"
value = "EMEA"
# ---------- end python ----------
python_2 = GhPythonScript(url=panel)  # -> out, key, value
# ---------- python_2: Python ----------
import rhinoscriptsyntax as rs

ghenv.Component.Message = "authcontext"
urlParts = url.split("/")

key = "authcontext"
value = urlParts[-2]
# ---------- end python_2 ----------
bearer = BearerTokenAuth(Token=data)
python_3 = GhPythonScript()  # -> out, endPoint
# ---------- python_3: Python ----------
__author__ = "ARZE"
__version__ = "2024.02.14"

import rhinoscriptsyntax as rs
ghenv.Component.Message = "Wind params end point"
endPoint  = "https://developer.api.autodesk.com/forma/wind-prediction/v1alpha/parameters"
# ---------- end python_3 ----------
ch = CreateHttpHeader(Key=python.key, Value=python.value)
cqp = CreateQueryParam(Key=python_2.key, Value=python_2.value)
mesh = Mesh([pipeline_2, pipeline])
merge = Merge(Data1=bearer, Data2=ch)
mjoin = MeshJoin(Meshes=mesh)
get = GETRequest(URL=python_3.endPoint, Params=cqp, Headers=merge)  # -> Status, Content, Response
fg_ta = GH_terrainArrays(Terrain=pipeline, TerrainBuilding=mjoin)  # -> HeightDictionary, AnalysisMesh
panel_2 = Panel(get.Status)
gh_postarray = GH_postArray(HeightArray=fg_ta.HeightDictionary, WindParameters=get.Content)
python_4 = GhPythonScript()  # -> out, endPoint
# ---------- python_4: Python ----------
__author__ = "ARZE"
__version__ = "2024.02.14"

import rhinoscriptsyntax as rs
ghenv.Component.Message = "Predict end point"
endPoint  = "https://developer.api.autodesk.com/forma/wind-prediction/v1alpha/predict"
# ---------- end python_4 ----------
merge_2 = Merge(Data1=bearer, Data2=ch)
ctb = CreateTextBody(
    Content=gh_postarray,
    IsHtmlChecked=False,
    IsJavascriptChecked=False,
    IsJsonChecked=True,
    IsTextChecked=False,
    IsXmlChecked=False)
post = POSTRequest(URL=python_4.endPoint, Body=ctb, Params=cqp, Headers=merge_2)  # -> Status, Content, Response
number_slider = Slider(1, range=0..1)
dejson = DeserializeJson(JSON=post.Content, OutputsLocked=False)  # -> Heatmap_data, Heatmap_mask, Metadata
range = Range(Domain=Domain(0, 1), Steps=10)
gradient = Gradient(
    LowerLimit="0",
    UpperLimit=number_slider,
    Parameter=flatten(range),
    stops=[0: RGB(39, 72, 161), 0: RGB(16, 55, 181), 0.162: RGB(29, 146, 242), 0.324: RGB(50, 227, 218), 0.487: RGB(130, 255, 178), 0.673: RGB(204, 227, 134), 0.821: RGB(255, 154, 82), 1: RGB(255, 46, 23)])
prob = Data(fg_ta.AnalysisMesh)
recolor_mesh = RecolorMesh(Mesh=prob, Result=dejson.Heatmap_data, ListOfColors=gradient, LowerBoundary=0, UpperBoundary=number_slider, Segments=10)  # -> ColoredMesh, Colors, Values
